# Grasshopper definition hslu_rrc_facade.ghx (Grasshopper 1.0.8)
# plug-ins: Robot Components

# ----
# Design Parameters
# DESIGN
length = Slider(2500, range=0..10000)
width = Slider(600, range=0..1000)
dimension = Slider(40, range=0..100)
cluster = Cluster_2(length=length, width=width, dimension=dimension)
geo = Geometry(cluster)

# ----
# VISUALISATION
# Robot Setup
cluster_2 = Cluster_6()
R = Robot(cluster_2)

# ----
# SOFTWARE
# Information
python_3_script = Python3Script()  # -> out
# ---------- python_3_script: Python ----------
# Make sure python and compas is installed 
#! python3
# r: compas

# Grasshopper Component Message
ghenv.Component.Message = 'GH Info'

import sys
import compas
import Grasshopper
import Rhino

# Get and print current software informations
print('Python Version : {}.{}.{}'.format(sys.version_info.major, sys.version_info.minor, sys.version_info.micro))
print('Rhino Version : {}'.format(Rhino.RhinoApp.Version))
print('Grasshopper Version : {}'.format(Grasshopper.Versioning.Version))
print('COMPAS Version : {}'.format(compas.__version__))
# ---------- end python_3_script ----------
panel = Panel(python_3_script)

# ---- group: demo_data
cluster_3 = Cluster_13()

# ---- group: INPUT
data = Data(cluster_3)

# ----
# Forward Kinematics
number_slider = Slider(-90, range=-270..270)
rj = RobotJointPosition(
    RobotJointPosition1=number_slider,
    RobotJointPosition2=Slider(0, range=-180..180),
    RobotJointPosition3=Slider(9, range=-225..85),
    RobotJointPosition4=Slider(-29, range=-180..180),
    RobotJointPosition5=Slider(90, range=-180..180),
    RobotJointPosition6=Slider(0, range=-270..270))
fk = ForwardKinematics(
    Robot=R,
    RobotJointPosition=rj,
    ExternalJointPosition=Slider(3000, range=0..3000),
    Hide_Posed_Meshes=False,
    Output_Posed_Meshes=False)  # -> EndPlane, ExternalAxisPlanes

panel_2 = Panel("C:\Users\jurij\Documents\GitHub\hslu_rrc_facade\process\data\geometry")
c_script = CSharpScript()  # -> log; inputs Brep: list, Centerlines: list, CutPlanesA: list, CutPlanesB: list, BeamSizes: list, LayerIDs: list
# ---------- c_script: C# ----------
// ExportSimGeometry.cs
// Grasshopper C# Script Component for exporting beam geometry as STL files.
//
// USAGE:
//   1. In GH, add a C# Script component
//   2. Copy-paste this entire script into the component
//   3. Set inputs:
//      - Breps        (List<Brep>)       : Finished beam Breps per element
//      - Centerlines  (List<Line>)       : Beam centerlines per element
//      - CutPlanesA   (List<Plane>)      : Cut plane A per element
//      - CutPlanesB   (List<Plane>)      : Cut plane B per element (unused for CutA, used for naming only)
//      - BeamSizes    (List<string>)     : "small" or "large" per element
//      - LayerIDs     (List<int>)        : Layer index per element
//      - FolderPath   (string)           : Output folder path
//      - Export       (bool)             : Toggle to trigger export
//   4. Set outputs:
//      - Log          (string)           : Export log
//
// OUTPUT:
//   process/data/geometry/
//     L{layer}_E{element}_raw.stl
//     L{layer}_E{element}_cutA.stl
//     L{layer}_E{element}_cutB.stl
//     sim_metadata.json
//
// All STLs are exported in grip-center-relative coordinates.
// Origin = centerline midpoint (where the gripper grabs).

using System;
using System.IO;
using System.Collections.Generic;
using System.Text;
using Rhino.Geometry;

// ============================================================
// GH Script Component: RunScript method
// ============================================================
// Inputs:
//   List<Brep> Breps
//   List<Line> Centerlines
//   List<Plane> CutPlanesA
//   List<Plane> CutPlanesB
//   List<string> BeamSizes
//   List<int> LayerIDs
//   string FolderPath
//   bool Export
// Outputs:
//   object Log

private void RunScript(
		List<object> Brep,
		List<object> Centerlines,
		List<object> CutPlanesA,
		List<object> CutPlanesB,
		List<object> BeamSizes,
		List<object> LayerIDs,
		object Export,
		ref object log)
{
    var log = new StringBuilder();

    if (!Export)
    {
        Log = "Export disabled. Set Export=True to run.";
        return;
    }

    // Validate inputs
    int n = Breps.Count;
    if (Centerlines.Count != n || CutPlanesA.Count != n || BeamSizes.Count != n || LayerIDs.Count != n)
    {
        Log = $"ERROR: Input list lengths don't match! Breps={n}, Centerlines={Centerlines.Count}, CutPlanesA={CutPlanesA.Count}";
        return;
    }

    // Create output folder
    if (!Directory.Exists(FolderPath))
        Directory.CreateDirectory(FolderPath);

    log.AppendLine($"Exporting {n} elements to: {FolderPath}");

    // Stock lengths per beam size
    var stockLength = new Dictionary<string, double>
    {
        { "small", 700.0 },
        { "large", 1300.0 }
    };

    double beamSection = 25.0; // mm cross-section

    // Metadata
    var metaElements = new List<string>();

    // Mesh parameters for Brep meshing
    var meshParams = MeshingParameters.Default;
    meshParams.MinimumEdgeLength = 0.5;
    meshParams.MaximumEdgeLength = 50.0;

    for (int i = 0; i < n; i++)
    {
        int layer = LayerIDs[i];
        string size = BeamSizes[i].Trim().Trim('"').Trim('\'');
        Line centerline = Centerlines[i];
        Plane cutPlaneA = CutPlanesA[i];
        Brep finishedBrep = Breps[i];

        string prefix = $"L{layer}_E{i}";
        log.AppendLine($"\n--- {prefix} ({size}) ---");

        // 1. Compute grip frame (origin = centerline midpoint)
        Point3d gripCenter = centerline.PointAt(0.5);
        Vector3d gripX = centerline.Direction;
        gripX.Unitize();
        Vector3d gripY = Vector3d.ZAxis; // World up
        Vector3d gripZ = Vector3d.CrossProduct(gripX, gripY);
        gripZ.Unitize();
        // Recompute Y to ensure orthogonality
        gripY = Vector3d.CrossProduct(gripZ, gripX);
        gripY.Unitize();

        Plane gripFrame = new Plane(gripCenter, gripX, gripY);
        Transform toLocal = Transform.PlaneToPlane(gripFrame, Plane.WorldXY);

        // 2. Generate RAW beam (box from stock length)
        double sLen = stockLength.ContainsKey(size) ? stockLength[size] : 700.0;
        double halfLen = sLen / 2.0;
        double halfSec = beamSection / 2.0;

        // Box centered on grip center, aligned with centerline
        Point3d boxMin = gripCenter - gripX * halfLen - gripY * halfSec - gripZ * halfSec;
        Point3d boxMax = gripCenter + gripX * halfLen + gripY * halfSec + gripZ * halfSec;

        // Build box via corner points in grip-aligned frame
        Plane boxPlane = new Plane(gripCenter - gripX * halfLen - gripY * halfSec - gripZ * halfSec, gripX, gripY);
        Box rawBox = new Box(gripFrame,
            new Interval(-halfLen, halfLen),
            new Interval(-halfSec, halfSec),
            new Interval(-halfSec, halfSec));
        Brep rawBrep = rawBox.ToBrep();

        // 3. Generate CutA geometry (raw split by Cut Plane A)
        Brep cutABrep = null;
        if (rawBrep != null)
        {
            // Split raw brep with Cut Plane A
            // Cut Plane Z points outward (away from beam center)
            // We keep the fragment containing the grip center
            Brep[] splitResults = rawBrep.Split(cutPlaneA.ToNurbsSurface(), 0.01);

            if (splitResults != null && splitResults.Length > 0)
            {
                // Find fragment containing grip center
                double bestDist = double.MaxValue;
                foreach (var fragment in splitResults)
                {
                    BoundingBox bb = fragment.GetBoundingBox(false);
                    double dist = gripCenter.DistanceTo(bb.Center);
                    if (dist < bestDist)
                    {
                        bestDist = dist;
                        cutABrep = fragment;
                    }
                }
                log.AppendLine($"  CutA: Split OK ({splitResults.Length} fragments, kept closest to grip center)");
            }
            else
            {
                // Fallback: try Brep.Trim
                Brep[] trimResults = rawBrep.Trim(cutPlaneA, 0.01);
                if (trimResults != null && trimResults.Length > 0)
                {
                    double bestDist2 = double.MaxValue;
                    foreach (var fragment in trimResults)
                    {
                        double dist = gripCenter.DistanceTo(fragment.GetBoundingBox(false).Center);
                        if (dist < bestDist2)
                        {
                            bestDist2 = dist;
                            cutABrep = fragment;
                        }
                    }
                    log.AppendLine($"  CutA: Trim fallback OK ({trimResults.Length} fragments)");
                }
                else
                {
                    log.AppendLine($"  CutA: WARNING - Split and Trim failed, using raw geometry");
                    cutABrep = rawBrep;
                }
            }
        }

        // 4. Export STLs
        // Raw
        string rawPath = Path.Combine(FolderPath, $"{prefix}_raw.stl");
        ExportBrepAsStl(rawBrep, toLocal, rawPath, meshParams, log);

        // CutA
        string cutAPath = Path.Combine(FolderPath, $"{prefix}_cutA.stl");
        if (cutABrep != null)
            ExportBrepAsStl(cutABrep, toLocal, cutAPath, meshParams, log);
        else
            log.AppendLine($"  WARNING: No CutA brep for {prefix}");

        // CutB (finished beam from student)
        string cutBPath = Path.Combine(FolderPath, $"{prefix}_cutB.stl");
        ExportBrepAsStl(finishedBrep, toLocal, cutBPath, meshParams, log);

        // Metadata entry
        string gripJson = FormatGripFrame(gripCenter, gripX, gripY);
        metaElements.Add(string.Format(
            "      {{\n        \"id\": {0},\n        \"beam_size\": \"{1}\",\n" +
            "        \"files\": {{\n          \"raw\": \"{2}_raw.stl\",\n" +
            "          \"cutA\": \"{2}_cutA.stl\",\n          \"cutB\": \"{2}_cutB.stl\"\n        }},\n" +
            "        \"grip_frame_world\": {3}\n      }}",
            i, size, prefix, gripJson));
    }

    // Write metadata JSON
    // Group elements by layer
    var layerGroups = new Dictionary<int, List<string>>();
    for (int i = 0; i < n; i++)
    {
        int layer = LayerIDs[i];
        if (!layerGroups.ContainsKey(layer))
            layerGroups[layer] = new List<string>();
        layerGroups[layer].Add(metaElements[i]);
    }

    var layersJson = new List<string>();
    foreach (var kv in layerGroups)
    {
        layersJson.Add(string.Format(
            "    {{\n      \"id\": {0},\n      \"element_count\": {1},\n      \"elements\": [\n{2}\n      ]\n    }}",
            kv.Key, kv.Value.Count, string.Join(",\n", kv.Value)));
    }

    string metaJson = string.Format(
        "{{\n  \"version\": \"1.0\",\n  \"project\": \"facade\",\n  \"beam_section_mm\": {0},\n" +
        "  \"layers\": [\n{1}\n  ]\n}}",
        beamSection, string.Join(",\n", layersJson));

    string metaPath = Path.Combine(FolderPath, "sim_metadata.json");
    File.WriteAllText(metaPath, metaJson);
    log.AppendLine($"\nMetadata written to: {metaPath}");
    log.AppendLine($"\nDone. Exported {n} elements ({n * 3} STL files).");

    Log = log.ToString();
}


// ============================================================
// Helper: Export Brep as binary STL
// ============================================================
private void ExportBrepAsStl(Brep brep, Transform toLocal,
    string filePath, MeshingParameters meshParams, StringBuilder log)
{
    if (brep == null)
    {
        log.AppendLine($"  ERROR: Null brep for {Path.GetFileName(filePath)}");
        return;
    }

    // Mesh the brep
    Mesh[] meshes = Mesh.CreateFromBrep(brep, meshParams);
    if (meshes == null || meshes.Length == 0)
    {
        log.AppendLine($"  ERROR: Failed to mesh brep for {Path.GetFileName(filePath)}");
        return;
    }

    // Combine all meshes
    Mesh combined = new Mesh();
    foreach (var m in meshes)
        combined.Append(m);
    combined.Faces.ConvertQuadsToTriangles();
    combined.Normals.ComputeNormals();
    combined.Compact();

    // Transform to grip-center-relative coordinates
    combined.Transform(toLocal);

    // Write binary STL
    WriteBinaryStl(combined, filePath);
    log.AppendLine($"  Exported: {Path.GetFileName(filePath)} ({combined.Faces.Count} triangles)");
}


// ============================================================
// Helper: Write binary STL file
// ============================================================
private void WriteBinaryStl(Mesh mesh, string filePath)
{
    using (var writer = new BinaryWriter(File.Open(filePath, FileMode.Create)))
    {
        // 80-byte header
        byte[] header = new byte[80];
        byte[] title = Encoding.ASCII.GetBytes("HSLU Facade SimBeam");
        Array.Copy(title, header, Math.Min(title.Length, 80));
        writer.Write(header);

        // Triangle count
        writer.Write((uint)mesh.Faces.Count);

        // Triangles
        for (int i = 0; i < mesh.Faces.Count; i++)
        {
            MeshFace face = mesh.Faces[i];

            // Face normal
            Vector3d normal = mesh.FaceNormals[i];
            writer.Write((float)normal.X);
            writer.Write((float)normal.Y);
            writer.Write((float)normal.Z);

            // Vertex 1
            Point3f v1 = mesh.Vertices[face.A];
            writer.Write(v1.X);
            writer.Write(v1.Y);
            writer.Write(v1.Z);

            // Vertex 2
            Point3f v2 = mesh.Vertices[face.B];
            writer.Write(v2.X);
            writer.Write(v2.Y);
            writer.Write(v2.Z);

            // Vertex 3
            Point3f v3 = mesh.Vertices[face.C];
            writer.Write(v3.X);
            writer.Write(v3.Y);
            writer.Write(v3.Z);

            // Attribute byte count (unused)
            writer.Write((ushort)0);
        }
    }
}


// ============================================================
// Helper: Format grip frame as JSON
// ============================================================
private string FormatGripFrame(Point3d origin, Vector3d xaxis, Vector3d yaxis)
{
    return string.Format(
        "{{\n          \"origin\": [{0:F6}, {1:F6}, {2:F6}],\n" +
        "          \"xaxis\": [{3:F6}, {4:F6}, {5:F6}],\n" +
        "          \"yaxis\": [{6:F6}, {7:F6}, {8:F6}]\n        }}",
        origin.X, origin.Y, origin.Z,
        xaxis.X, xaxis.Y, xaxis.Z,
        yaxis.X, yaxis.Y, yaxis.Z);
}
# ---------- end c_script ----------

# ----
# Data Export
update_json_file = Button()
python_3_script_2 = Python3Script()  # -> out, json_path
# ---------- python_3_script_2: Python ----------
# Grasshopper Component Message
ghenv.Component.Message = 'Create JSON File Path'

# Read current path
cur_path = ghdoc.Path

# Navigate from design/ or grasshopper/ up to repo root, then into process/data/
last_slash = cur_path.rfind('\\')
folder = cur_path[:last_slash]

# Go up one level (from design/ or grasshopper/ to repo root)
repo_root = folder[:folder.rfind('\\')]

# Build path to fab_data.json
repo_root = repo_root.replace("\\", "/")
json_path = repo_root + "/process/data/fab_data.json"
# ---------- end python_3_script_2 ----------

# ----
# Plane/Frame Data
# INPUT (pro Element):
# 
# genauer Beschrieben in STUDENT_INPUT.md
# 
# DataTree-Struktur: {Layer ; Element}
# Reihenfolge im Tree = Platzierungsreihenfolge.
# 
# 0 = Brep ---> Balken-Geometrie (zur Visualisierung)
# 1 = Centerline ---> Mittelachse des Balkens (Line)
# 2 = Cut Plane A ---> Schnittebene Ende A (Plane)
# 3 = Cut Plane B ---> Schnittebene Ende B (Plane)
# 4 = Glue Plane A ---> Leimebene 1 (Plane, Unterseite am Rand)
# 5 = Glue Plane B ---> Leimebene 2 (Plane, optional - kann leer sein)
# Export to JSON
viewer = ParamViewer(data)
cluster_4 = Cluster_4(fab_data=data)  # -> fab_data_2, fab_visualize
python_3_script_3 = Python3Script(update=update_json_file, fab_data=cluster_4.fab_data_2, file_path=python_3_script_2.json_path)  # -> output, details; inputs fab_data: tree
# ---------- python_3_script_3: Python ----------
# Grasshopper Component: Export Fab Data for Facade
# ghenv.Component.Message = 'Export Facade JSON'
#
# ==============================================================================
# INPUTS
# ==============================================================================
#
#   update (bool):        Trigger export
#   file_path (str):      Path to output JSON file
#   fab_data (DataTree):  Tree with {layer;element} structure
#
# ==============================================================================
# FAB_DATA INDEX MAPPING (Facade)
# ==============================================================================
#
#   0  = brep             (skip, not exported)
#   1  = centerline        (skip, not exported)
#   2  = cut_plane_a       (skip, not exported)
#   3  = cut_plane_b       (skip, not exported)
#   4  = glue_plane_a      (skip, not exported)
#   5  = glue_plane_b      (skip, not exported)
#   6  = place_position    << Frame (in ob_HSLU_Place coordinates)
#   7  = cut_position_a    << Frame (in ob_HSLU_Cut coordinates)
#   8  = cut_position_b    << Frame (in ob_HSLU_Cut coordinates)
#   9  = glue_position_a   << Frame (in ob_HSLU_Glue coordinates)
#   10 = glue_position_b   << Frame (in ob_HSLU_Glue coordinates, can be null)
#   11 = beam_size         << String ("small" or "large")
#
# ==============================================================================
# OUTPUT
# ==============================================================================
#   output (str):  Short status message
#   details (str): Detailed export log

import os
from datetime import datetime

import compas
from compas.geometry import Point, Frame, Vector

from Grasshopper import DataTree
from Grasshopper.Kernel.Data import GH_Path
import Rhino


# ==============================================================================
# Index mapping: index -> position name (Frames only)
# ==============================================================================
INDEX_MAP = {
    # 0-5 = input geometry (brep, centerline, planes) - skip
    6:  "place_position",
    7:  "cut_position_a",
    8:  "cut_position_b",
    9:  "glue_position_a",
    10: "glue_position_b",
}

# Index for string values
BEAM_SIZE_INDEX = 11


# ==============================================================================
# Helper functions
# ==============================================================================

def to_compas_frame(plane):
    """Convert Rhino Plane to COMPAS Frame."""
    if plane is None:
        return None
    if not isinstance(plane, Rhino.Geometry.Plane):
        return None
    return Frame(
        Point(plane.Origin.X, plane.Origin.Y, plane.Origin.Z),
        Vector(plane.XAxis.X, plane.XAxis.Y, plane.XAxis.Z),
        Vector(plane.YAxis.X, plane.YAxis.Y, plane.YAxis.Z)
    )


def get_branch(tree, path):
    """Get branch from DataTree as list."""
    if tree is None:
        return []
    try:
        branch = tree.Branch(path)
        return list(branch) if branch else []
    except:
        return []


def analyze_tree(tree):
    """Analyze tree structure and return (n_layers, elements_per_layer)."""
    if tree is None:
        return 0, {}

    paths = tree.Paths
    if not paths:
        return 0, {}

    elements_per_layer = {}
    for p in paths:
        if p.Length >= 2:
            layer = p[0]
            element = p[1]
            if layer not in elements_per_layer:
                elements_per_layer[layer] = 0
            elements_per_layer[layer] = max(elements_per_layer[layer], element + 1)

    n_layers = max(elements_per_layer.keys()) + 1 if elements_per_layer else 0
    return n_layers, elements_per_layer


def validate_element_basic(element, layer_idx, elem_idx):
    """Basic validation during export. Returns list of warnings."""
    warnings = []
    prefix = "L{} E{}".format(layer_idx, elem_idx)

    # Check required frames
    for field in ["place_position", "cut_position_a", "cut_position_b", "glue_position_a"]:
        if field not in element:
            warnings.append("{}: '{}' fehlt!".format(prefix, field))

    # Check beam_size
    beam_size = element.get("beam_size", "")
    if beam_size not in ("small", "large"):
        warnings.append("{}: beam_size '{}' ungueltig (nur 'small' oder 'large')".format(prefix, beam_size))

    # Check place bounds (600 x 2500)
    place = element.get("place_position")
    if place is not None:
        x, y = place.point.x, place.point.y
        if x < -10 or x > 2510:
            warnings.append("{}: place X={:.0f} ausserhalb Rahmen (0-2500)".format(prefix, x))
        if y < -610 or y > 10:
            warnings.append("{}: place Y={:.0f} ausserhalb Rahmen (-600 - 0)".format(prefix, y))

    return warnings


# ==============================================================================
# Main Export Logic
# ==============================================================================

log = []

if update:
    # Create output directory if needed
    last_slash = max(file_path.rfind('/'), file_path.rfind('\\'))
    data_dir = file_path[:last_slash] if last_slash != -1 else ""

    if data_dir and not os.path.exists(data_dir):
        os.makedirs(data_dir)

    # Analyze tree
    n_layers, elements_per_layer = analyze_tree(fab_data)

    if n_layers > 2:
        log.append("[WARNUNG] {} Layer erkannt - maximal 2 erlaubt!".format(n_layers))

    log.append("Erkannt: {} Layer".format(n_layers))
    for layer, count in sorted(elements_per_layer.items()):
        log.append("  Layer {}: {} Elemente".format(layer, count))

    # Build layers
    layers = []
    total_elements = 0
    all_warnings = []

    for layer_idx in range(n_layers):
        n_elements = elements_per_layer.get(layer_idx, 0)
        log.append("")
        log.append("Verarbeite Layer {} ({} Elemente)...".format(layer_idx, n_elements))

        elements = []

        for elem_idx in range(n_elements):
            branch = get_branch(fab_data, GH_Path(layer_idx, elem_idx))

            element = {"id": elem_idx}

            # Extract beam_size (string)
            if BEAM_SIZE_INDEX < len(branch) and branch[BEAM_SIZE_INDEX] is not None:
                element["beam_size"] = str(branch[BEAM_SIZE_INDEX])

            # Extract position frames
            for idx, pos_name in INDEX_MAP.items():
                if idx < len(branch):
                    frame = to_compas_frame(branch[idx])
                    if frame is not None:
                        element[pos_name] = frame

            # Validate
            warnings = validate_element_basic(element, layer_idx, elem_idx)
            all_warnings.extend(warnings)

            elements.append(element)

        if elements:
            log.append("  Keys: {}".format(list(elements[0].keys())))

        layers.append({
            "id": layer_idx,
            "elements": elements
        })
        total_elements += len(elements)

    # Build export structure
    export_data = {
        "layers": layers,
        "metadata": {
            "created": datetime.now().isoformat(),
            "layer_count": len(layers),
            "total_element_count": total_elements,
            "version": "3.0",
            "project": "facade",
            "frame_size": [600, 2500],
            "beam_section": 25,
        }
    }

    # Show warnings
    if all_warnings:
        log.append("")
        log.append("{} WARNUNGEN:".format(len(all_warnings)))
        for w in all_warnings:
            log.append("  - " + w)

    # Export JSON
    compas.json_dump(export_data, file_path, pretty=True)

    # Summary
    log.append("")
    log.append("Datei: {}".format(file_path))
    for layer in layers:
        log.append("  Layer {}: {} Elemente".format(layer["id"], len(layer["elements"])))

    if all_warnings:
        output = "Done - {} elements exported ({} warnings)".format(total_elements, len(all_warnings))
    else:
        output = "Done - {} elements exported!".format(total_elements)

    details = "\n".join(log)

else:
    output = "Press Button to Export"
    details = ""
# ---------- end python_3_script_3 ----------

# ----
# FABRICATION
export_confirmation = Panel(python_3_script_3.output)

# ----
# Inverse Kinematics - Show Element
layer = Slider(0, range=0..1)
element = Slider(17, range=0..100)
cluster_5 = Cluster_5(tree=cluster_4.fab_visualize, layer=layer, element=element, robot=R)  # -> brep, mesh
brep = Brep(cluster_5.brep)
mesh = Mesh(cluster_5.mesh)

# ----
# Inverse Kinematics - Show Everything
cluster_6 = Cluster_7(tree=cluster_4.fab_visualize, robot=R)  # -> brep, mesh
brep_2 = Brep(cluster_6.brep)
mesh_2 = Mesh(cluster_6.mesh)

item = ListItem(List=cluster_4.fab_data_2, Index=0, Wrap=True)
py3 = Python3Script(update=Button(), folder_path=panel_2, fab_data=cluster_4.fab_data_2)  # -> out, a; inputs fab_data: tree
# ---------- py3: Python ----------
# Grasshopper Component: Export Simulation Geometry
# ghenv.Component.Message = 'Export STL v1'
#
# ==============================================================================
# INPUTS
# ==============================================================================
#
#   update (bool):        Trigger export
#   folder_path (str):    Output folder (e.g. process/data/geometry)
#   fab_data (DataTree):  Same tree as fab_data export: {Layer;Element}
#
# ==============================================================================
# FAB_DATA INDEX MAPPING (Facade project)
# ==============================================================================
#
#   0  = Brep              << Finished beam geometry (= cutB)
#   1  = Centerline        << Line (for raw beam + grip center)
#   2  = Cut Plane A       << Plane (Z outward, for cutA split)
#   3  = Cut Plane B       << Plane (Z outward)
#   4  = Glue Plane A      (skip)
#   5  = Glue Plane B      (skip, optional)
#
# Adjust indices below if your GH template uses a different tree layout.
#
# ==============================================================================
# OUTPUT
# ==============================================================================
#   output (str): Export log
#
# ==============================================================================
# FILES PRODUCED
# ==============================================================================
#   L{layer}_E{element}_raw.stl    Raw stock beam (box)
#   L{layer}_E{element}_cutA.stl   After first miter cut
#   L{layer}_E{element}_cutB.stl   Finished beam (both cuts)
#   sim_metadata.json               Element metadata
#
# All STLs in grip-center-relative coordinates (origin = centerline midpoint).

import os
import struct
import json
import System

import Rhino
import Rhino.Geometry as rg

from Grasshopper import DataTree
from Grasshopper.Kernel.Data import GH_Path


# ==============================================================================
# Configuration — adjust if your tree layout differs
# ==============================================================================

BREP_INDEX = 0           # Finished Brep
CENTERLINE_INDEX = 1     # Centerline (Line)
CUT_PLANE_A_INDEX = 2    # Cut Plane A
CUT_PLANE_B_INDEX = 3    # Cut Plane B

BEAM_SECTION = 25.0      # mm cross-section (must match globals.py)
STOCK_LENGTHS = {         # mm stock lengths per category (must match validate.py)
    "small": 700.0,
    "large": 1300.0,
}
SIZE_THRESHOLD = 700.0    # Centerline <= threshold -> "small", else "large"

MESH_MIN_EDGE = 0.5
MESH_MAX_EDGE = 50.0
SPLIT_TOLERANCE = 0.01
SPLIT_PLANE_SIZE = 5000.0  # Half-size of cutting plane surface (mm)


# ==============================================================================
# Geometry dereferencing (Rhino 8 CPython: tree items can be Guids)
# ==============================================================================

def deref(item):
    """Dereference a DataTree item to its Rhino geometry.

    In Rhino 8 CPython, geometry in DataTrees comes as System.Guid
    references. GH-created geometry lives in ghdoc, Rhino-referenced
    geometry lives in the Rhino document. This tries both.
    """
    # GH_Goo wrapper (e.g. GH_Brep, GH_Line, GH_Plane)
    if hasattr(item, 'Value'):
        return deref(item.Value)

    # Guid reference -> try GH doc first, then Rhino doc
    if isinstance(item, System.Guid):
        import scriptcontext as sc
        old_doc = sc.doc

        # Strategy 1: GH document (geometry created by GH components)
        try:
            sc.doc = ghdoc
            rhino_obj = sc.doc.Objects.FindId(item)
            if rhino_obj is not None:
                sc.doc = old_doc
                return rhino_obj.Geometry
        except:
            pass

        # Strategy 2: Active Rhino document (referenced geometry)
        try:
            sc.doc = Rhino.RhinoDoc.ActiveDoc
            rhino_obj = sc.doc.Objects.FindId(item)
            if rhino_obj is not None:
                sc.doc = old_doc
                return rhino_obj.Geometry
        except:
            pass

        sc.doc = old_doc
        return None

    return item


def to_brep(item):
    """Extract Brep from a tree item."""
    geom = deref(item)
    if isinstance(geom, rg.Brep):
        return geom
    if isinstance(geom, rg.Extrusion):
        return geom.ToBrep()
    return None


def to_line(item):
    """Extract Line from a tree item (handles LineCurve, NurbsCurve, etc.)."""
    geom = deref(item)
    if isinstance(geom, rg.Line):
        return geom
    if isinstance(geom, rg.LineCurve):
        return geom.Line
    if isinstance(geom, rg.Curve):
        return rg.Line(geom.PointAtStart, geom.PointAtEnd)
    return None


def to_plane(item):
    """Extract Plane from a tree item."""
    geom = deref(item)
    if isinstance(geom, rg.Plane):
        return geom
    # PlaneSurface referenced from Rhino
    if isinstance(geom, rg.PlaneSurface):
        ok, frame = geom.TryGetPlane()
        if ok:
            return frame
    # Surface -> try to get plane
    if isinstance(geom, rg.Surface):
        ok, frame = geom.TryGetPlane()
        if ok:
            return frame
    return None


# ==============================================================================
# Tree helpers (same pattern as export_fab_data_v3.py)
# ==============================================================================

def get_branch(tree, path):
    """Get branch from DataTree as list."""
    if tree is None:
        return []
    try:
        branch = tree.Branch(path)
        return list(branch) if branch else []
    except:
        return []


def analyze_tree(tree):
    """Analyze tree structure, return (n_layers, elements_per_layer dict)."""
    if tree is None:
        return 0, {}
    paths = tree.Paths
    if not paths:
        return 0, {}

    elements_per_layer = {}
    for p in paths:
        if p.Length >= 2:
            layer = p[0]
            element = p[1]
            if layer not in elements_per_layer:
                elements_per_layer[layer] = 0
            elements_per_layer[layer] = max(elements_per_layer[layer], element + 1)

    n_layers = max(elements_per_layer.keys()) + 1 if elements_per_layer else 0
    return n_layers, elements_per_layer


# ==============================================================================
# Geometry helpers
# ==============================================================================

def get_beam_size(centerline):
    """Determine beam size category from centerline length."""
    length = centerline.Length
    return "small" if length <= SIZE_THRESHOLD else "large"


def get_stock_length(size):
    """Get stock length for beam size category."""
    return STOCK_LENGTHS.get(size, STOCK_LENGTHS["small"])


def make_grip_frame(centerline):
    """Compute grip frame: origin at centerline midpoint.

    Convention (matches gripper TCP):
      X = along beam (centerline direction)
      Z = -world Z (gripper approaches from above)
      Y = Z x X (derived, right-handed)

    Returns (grip_center, grip_plane, transform_to_local).
    """
    grip_center = centerline.PointAt(0.5)

    grip_x = centerline.Direction
    grip_x.Unitize()
    grip_z = -rg.Vector3d.ZAxis  # Gripper points down
    grip_y = rg.Vector3d.CrossProduct(grip_z, grip_x)
    grip_y.Unitize()

    grip_plane = rg.Plane(grip_center, grip_x, grip_y)
    to_local = rg.Transform.PlaneToPlane(grip_plane, rg.Plane.WorldXY)

    return grip_center, grip_plane, to_local


def make_raw_brep(centerline, grip_center, grip_plane, size):
    """Generate raw stock beam as Box Brep."""
    stock_len = get_stock_length(size)
    half_len = stock_len / 2.0
    half_sec = BEAM_SECTION / 2.0

    box = rg.Box(
        grip_plane,
        rg.Interval(-half_len, half_len),
        rg.Interval(-half_sec, half_sec),
        rg.Interval(-half_sec, half_sec)
    )
    return box.ToBrep()


def split_brep_with_plane(brep, cut_plane, grip_center):
    """Split brep with a cut plane, keep fragment containing grip_center.

    Returns the split Brep, or the original if split fails.
    """
    # Create large planar surface as cutter
    srf = rg.PlaneSurface(
        cut_plane,
        rg.Interval(-SPLIT_PLANE_SIZE, SPLIT_PLANE_SIZE),
        rg.Interval(-SPLIT_PLANE_SIZE, SPLIT_PLANE_SIZE)
    )
    cutter = srf.ToBrep()

    # Try Split
    fragments = brep.Split(cutter, SPLIT_TOLERANCE)
    if fragments and len(fragments) > 0:
        # Keep fragment closest to grip center
        best = None
        best_dist = float('inf')
        for frag in fragments:
            bb = frag.GetBoundingBox(False)
            dist = grip_center.DistanceTo(bb.Center)
            if dist < best_dist:
                best_dist = dist
                best = frag
        if best:
            # Cap the open cut face to make it a closed solid
            capped = best.CapPlanarHoles(SPLIT_TOLERANCE)
            if capped is not None:
                best = capped
            return best, "Split OK ({} fragments)".format(len(fragments))

    # Fallback: Trim
    trimmed = brep.Trim(cut_plane, SPLIT_TOLERANCE)
    if trimmed and len(trimmed) > 0:
        best = None
        best_dist = float('inf')
        for frag in trimmed:
            dist = grip_center.DistanceTo(frag.GetBoundingBox(False).Center)
            if dist < best_dist:
                best_dist = dist
                best = frag
        if best:
            capped = best.CapPlanarHoles(SPLIT_TOLERANCE)
            if capped is not None:
                best = capped
            return best, "Trim fallback OK ({} fragments)".format(len(trimmed))

    # Last resort: return original
    return brep, "WARNING: Split+Trim failed, using original"


def brep_to_mesh(brep):
    """Convert Brep to triangulated Mesh."""
    mp = rg.MeshingParameters.Default
    mp.MinimumEdgeLength = MESH_MIN_EDGE
    mp.MaximumEdgeLength = MESH_MAX_EDGE

    meshes = rg.Mesh.CreateFromBrep(brep, mp)
    if not meshes:
        return None

    combined = rg.Mesh()
    for m in meshes:
        combined.Append(m)
    combined.Faces.ConvertQuadsToTriangles()
    combined.Normals.ComputeNormals()
    combined.Compact()
    return combined


# ==============================================================================
# Binary STL writer
# ==============================================================================

def write_binary_stl(mesh, file_path):
    """Write mesh as binary STL file."""
    with open(file_path, 'wb') as f:
        # 80-byte header
        header = b'HSLU Facade SimBeam' + b'\x00' * (80 - 19)
        f.write(header)

        # Triangle count
        n_faces = mesh.Faces.Count
        f.write(struct.pack('<I', n_faces))

        # Triangles
        for i in range(n_faces):
            face = mesh.Faces[i]

            # Normal
            n = mesh.FaceNormals[i]
            f.write(struct.pack('<fff', n.X, n.Y, n.Z))

            # Vertex A
            v = mesh.Vertices[face.A]
            f.write(struct.pack('<fff', v.X, v.Y, v.Z))

            # Vertex B
            v = mesh.Vertices[face.B]
            f.write(struct.pack('<fff', v.X, v.Y, v.Z))

            # Vertex C
            v = mesh.Vertices[face.C]
            f.write(struct.pack('<fff', v.X, v.Y, v.Z))

            # Attribute byte count
            f.write(struct.pack('<H', 0))


def export_brep_as_stl(brep, to_local, file_path):
    """Mesh brep, transform to local coords, write STL.

    Returns (success, triangle_count, message).
    """
    if brep is None:
        return False, 0, "Null brep"

    mesh = brep_to_mesh(brep)
    if mesh is None:
        return False, 0, "Meshing failed"

    mesh.Transform(to_local)
    write_binary_stl(mesh, file_path)
    return True, mesh.Faces.Count, "OK"


# ==============================================================================
# Metadata JSON
# ==============================================================================

def format_grip_frame(grip_center, grip_plane):
    """Format grip frame for metadata JSON."""
    return {
        "origin": [round(grip_center.X, 6), round(grip_center.Y, 6), round(grip_center.Z, 6)],
        "xaxis": [round(grip_plane.XAxis.X, 6), round(grip_plane.XAxis.Y, 6), round(grip_plane.XAxis.Z, 6)],
        "yaxis": [round(grip_plane.YAxis.X, 6), round(grip_plane.YAxis.Y, 6), round(grip_plane.YAxis.Z, 6)],
    }


# ==============================================================================
# Main export logic
# ==============================================================================

print("=" * 50)
print("Export Simulation Geometry")
print("=" * 50)

if update:
    # Create output folder
    if not os.path.exists(folder_path):
        os.makedirs(folder_path)

    # Analyze tree
    n_layers, elements_per_layer = analyze_tree(fab_data)

    print("Detected {} layers".format(n_layers))
    for layer, count in sorted(elements_per_layer.items()):
        print("  Layer {}: {} elements".format(layer, count))

    if n_layers == 0:
        output = "ERROR: No layers detected in DataTree"
        print(output)
    else:
        # Process all elements
        meta_layers = []
        total_elements = 0
        total_files = 0
        errors = []

        for layer_idx in range(n_layers):
            n_elements = elements_per_layer.get(layer_idx, 0)
            print("\nLayer {} ({} elements)".format(layer_idx, n_elements))

            meta_elements = []

            for elem_idx in range(n_elements):
                branch = get_branch(fab_data, GH_Path(layer_idx, elem_idx))
                prefix = "L{}_E{}".format(layer_idx, elem_idx)

                if len(branch) < 4:
                    msg = "{}: Branch too short ({} items, need >= 4)".format(prefix, len(branch))
                    errors.append(msg)
                    print("  " + msg)
                    continue

                # Extract data from tree (dereference Guids -> geometry)
                finished_brep = to_brep(branch[BREP_INDEX])
                centerline = to_line(branch[CENTERLINE_INDEX])
                cut_plane_a = to_plane(branch[CUT_PLANE_A_INDEX])

                if finished_brep is None or centerline is None or cut_plane_a is None:
                    msg = "{}: Missing Brep={} Centerline={} CutPlaneA={}".format(
                        prefix,
                        type(branch[BREP_INDEX]).__name__ if finished_brep is None else "OK",
                        type(branch[CENTERLINE_INDEX]).__name__ if centerline is None else "OK",
                        type(branch[CUT_PLANE_A_INDEX]).__name__ if cut_plane_a is None else "OK")
                    errors.append(msg)
                    print("  " + msg)
                    continue

                # Beam size from centerline length
                size = get_beam_size(centerline)

                # Grip frame
                grip_center, grip_plane, to_local = make_grip_frame(centerline)

                # --- RAW beam ---
                raw_brep = make_raw_brep(centerline, grip_center, grip_plane, size)
                raw_path = os.path.join(folder_path, "{}_raw.stl".format(prefix))
                ok, n_tri, msg = export_brep_as_stl(raw_brep, to_local, raw_path)
                print("  {} raw: {} ({} tri)".format(prefix, msg, n_tri))
                if ok:
                    total_files += 1
                else:
                    errors.append("{} raw: {}".format(prefix, msg))

                # --- CutA beam (raw split by Cut Plane A) ---
                if raw_brep is not None:
                    cut_a_brep, split_msg = split_brep_with_plane(raw_brep, cut_plane_a, grip_center)
                else:
                    cut_a_brep = None
                    split_msg = "No raw brep"

                cut_a_path = os.path.join(folder_path, "{}_cutA.stl".format(prefix))
                ok, n_tri, msg = export_brep_as_stl(cut_a_brep, to_local, cut_a_path)
                print("  {} cutA: {} - {} ({} tri)".format(prefix, split_msg, msg, n_tri))
                if ok:
                    total_files += 1
                else:
                    errors.append("{} cutA: {}".format(prefix, msg))

                # --- CutB beam (finished = student's Brep) ---
                cut_b_path = os.path.join(folder_path, "{}_cutB.stl".format(prefix))
                ok, n_tri, msg = export_brep_as_stl(finished_brep, to_local, cut_b_path)
                print("  {} cutB: {} ({} tri)".format(prefix, msg, n_tri))
                if ok:
                    total_files += 1
                else:
                    errors.append("{} cutB: {}".format(prefix, msg))

                # Metadata
                meta_elements.append({
                    "id": elem_idx,
                    "beam_size": size,
                    "files": {
                        "raw": "{}_raw.stl".format(prefix),
                        "cutA": "{}_cutA.stl".format(prefix),
                        "cutB": "{}_cutB.stl".format(prefix),
                    },
                    "grip_frame_world": format_grip_frame(grip_center, grip_plane),
                })

                total_elements += 1

            meta_layers.append({
                "id": layer_idx,
                "element_count": len(meta_elements),
                "elements": meta_elements,
            })

        # Write metadata JSON
        metadata = {
            "version": "1.0",
            "project": "facade",
            "beam_section_mm": BEAM_SECTION,
            "layers": meta_layers,
        }
        meta_path = os.path.join(folder_path, "sim_metadata.json")
        with open(meta_path, 'w') as f:
            json.dump(metadata, f, indent=2)

        # Summary
        print("\n" + "=" * 50)
        print("EXPORT COMPLETE")
        print("=" * 50)
        print("Folder: {}".format(folder_path))
        print("Elements: {}".format(total_elements))
        print("STL files: {}".format(total_files))
        if errors:
            print("\nErrors ({}):\n  {}".format(len(errors), "\n  ".join(errors)))

        output = "OK: {} elements, {} STL files".format(total_elements, total_files)
        if errors:
            output += " ({} errors)".format(len(errors))

else:
    output = "Set update=True"
    print("Waiting for update=True")

print("\nDone")
# ---------- end py3 ----------
rec = DataRecorder(py3.out, DataLimit=-10, RecordData=True)
panel_3 = Panel(rec)

# ==== cluster Cluster_2
length = ClusterInput()
width = ClusterInput()
dimension = ClusterInput()
length_2 = Data(length)
width_2 = Data(width)
dimension_2 = Data(dimension)
division = Division(A=dimension_2, B="2")
multiplication = Multiplication(A=dimension_2, B="2")
neg = Negative(Value=division)
neg_2 = Negative(Value=dimension_2)
pt = ConstructPoint(XCoordinate=0, YCoordinate=neg, ZCoordinate=division)
pt_2 = ConstructPoint(XCoordinate=division, YCoordinate=neg_2, ZCoordinate=division)
subtraction = Subtraction(A=width_2, B=multiplication)
X = UnitX(Factor=1)
Y = UnitY(Factor=1)
neg_3 = Negative(Value=subtraction)
subtraction_2 = Subtraction(A=width_2, B=dimension_2)
subtraction_3 = Subtraction(A=length_2, B=dimension_2)
line = LineSDL(Start=pt, Direction=X, Length=length_2)
line_2 = LineSDL(Start=pt_2, Direction=Y, Length=neg_3)
neg_4 = Negative(Value=subtraction_2)
Y_2 = UnitY(Factor=neg_4)
X_2 = UnitX(Factor=subtraction_3)
move = Move(Geometry=line, Motion=Y_2)  # -> Geometry, Transform
move_2 = Move(Geometry=line_2, Motion=X_2)  # -> Geometry, Transform
neg_5 = Negative(Value=division)
merge = Merge(Data1=line, Data2=move.Geometry, Data3=line_2, Data4=move_2.Geometry)  # -> graft(Result)
dom = ConstructDomain(DomainStart=neg_5, DomainEnd=division)
cluster = Cluster(crv=merge, data=dom)
B = ClusterOutput(cluster)

# ==== cluster Cluster_4
fab_data = ClusterInput()  # 0 = brep 1 = centerline 2 = cut_plane_a 3 = cut_plane_b 4 = glue_plane_a 5 = glue_plane_b
py3 = Python3Script(fab_data=fab_data)  # -> out, padded; inputs fab_data: tree
# ---------- py3: Python ----------
# GHPython: Pad Input                                                                                                                                                                                                    
# Input: fab_data (DataTree), Output: padded (DataTree)                                                                                                                                                                    EXPECTED = 6                                                                                                                                                                                                             
                                                                                                                                                                                                                           
from Grasshopper import DataTree
from Grasshopper.Kernel.Data import GH_Path  

EXPECTED = 6 

padded = DataTree[object]()

for path in fab_data.Paths:
    branch = list(fab_data.Branch(path))
    while len(branch) < EXPECTED:
        branch.append(None)
    for item in branch:
        padded.Add(item, path)
# ---------- end py3 ----------

# ---- group: tree
data = Data(py3.padded)

# ---- group: ob_hslu_cut
# CUT
offset_workobject_ob_hslu_cut = Panel("0,0,0")
Y = UnitY(Factor=1)
Z = UnitZ(Factor=1)
pl = ConstructPlane(Origin=offset_workobject_ob_hslu_cut, XAxis=Y, YAxis=Z)

# ----
Z_2 = UnitZ(Factor=Slider(160, range=0..1000))
cir = Circle(Plane=pl, Radius=Slider(200, range=0..1000))
neg = Negative(Value=Z_2)
move = Move(Geometry=cir, Motion=neg)  # -> Geometry, Transform

# ---- group: ob_hslu_cut
# CUT
X = UnitX(Factor=1)
Y_2 = UnitY(Factor=1)
neg_2 = Negative(Value=X)
neg_3 = Negative(Value=Y_2)
pt = Point(Point(-1194.000009, -192.2628066, 41.00005693))
pl_2 = ConstructPlane(Origin=pt, XAxis=neg_2, YAxis=neg_3)

# ---- group: ob_hslu_glue
# GLUE
offset_workobject_ob_hslu_glue = Panel("0,0,0")
X_2 = UnitX(Factor=1)
Y_3 = UnitY(Factor=1)
neg_4 = Negative(Value=Y_3)
pl_3 = ConstructPlane(Origin=offset_workobject_ob_hslu_glue, XAxis=X_2, YAxis=neg_4)

# GLUE
X_3 = UnitX(Factor=1)
Y_4 = UnitY(Factor=1)
neg_5 = Negative(Value=Y_4)
pt_2 = Point(Point(-1291.938096, 132.7373872, 1247.000057))
pl_4 = ConstructPlane(Origin=pt_2, XAxis=X_3, YAxis=neg_5)

# ----
# Place Position
# o = input slider for the moment
# x = centerline
# y = derived
# z = z-
panel = Panel("1")
# Place
item = ListItem(List=py3.padded, Index=panel, Wrap=True)
Z_3 = UnitZ(Factor=1)

# ---- group: centerline
line = Line(item)

# ----
eval = EvaluateCurve(Curve=line, Parameter=Slider(0.5, range=0..1))  # -> Point, Tangent, Angle
xprod = CrossProduct(VectorA=line, VectorB=Z_3, Unitize=False)  # -> Vector, Length
pl_5 = ConstructPlane(Origin=eval.Point, XAxis=line, YAxis=xprod.Vector)

# ---- group: place_position
pln = Plane(pl_5)

# ----
deplane = DeconstructPlane(Plane=pln)  # -> Origin, XAxis, YAxis, ZAxis
pdecon = Deconstruct(Point=deplane.Origin)  # -> XComponent, YComponent, ZComponent
addition = Addition(A=pdecon.XComponent, B=Slider(600, range=0..1000))
subtraction = Subtraction(A=addition, B=Slider(450, range=0..1000))
ej = ExternalJointPosition(ExternalJointPositionA=subtraction, ExternalJointPositionB=9000000000)

# ----
# Place
# Place Position
panel_2 = Panel("0")
item_2 = ListItem(List=data, Index=panel_2, Wrap=True)
rt = RobotTarget(Plane=pln, ExternalJointPosition=ej, Set_External_Joint_Position=True, Set_Reference_Plane=False)

# ---- group: place_brep
brep = Brep(item_2)

# ---- group: place_target
T = Target(rt)

# ----
# 0 = place_brep
# 1 = place_target
# 2 = cut_brep_a
# 3 = cut_target_a
# 4 = cut_brep_b
# 5 = cut_target_b
# 6 = glue_brep_a
# 7 = glue_target_a
# 8 = glue_brep_b
# 9 = glue_target_b
# 0 = place_brep
# 1 = place_target
# 2 = cut_brep_a
# 3 = cut_target_a
# 4 = cut_brep_b
# 5 = cut_target_b
# 0 = place_brep
# 1 = place_target
# 2 = cut_brep_a
# 3 = cut_target_a
# 4 = cut_brep_b
# 5 = cut_target_b
# 6 = glue_brep_a
# 7 = glue_target_a
# 8 = glue_brep_b
# 9 = glue_target_b
# 0 = place_brep
# 1 = place_target
# VISUALISATION
merge = Merge(Data1=brep, Data2=T)

# ----
# PRODUCTION
# 0 = brep
# 1 = centerline
# 2 = cut_plane_a
# 3 = cut_plane_b
# 4 = glue_plane_a
# 5 = glue_plane_b
# 6 = place_position
# 7 = cut_position_a
# 8 = cut_position_b
# 9 = glue_position_a
# 10 = glue_position_b
# 11 = beam_size
# 0 = brep
# 1 = centerline
# 2 = cut_plane_a
# 3 = cut_plane_b
# 4 = glue_plane_a
# 5 = glue_plane_b
# 6 = place_position
# 7 = cut_position_a
# 8 = cut_position_b
# 9 = glue_position_a
# 10 = glue_position_b
# 0 = brep
# 1 = centerline
# 2 = cut_plane_a
# 3 = cut_plane_b
# 4 = glue_plane_a
# 5 = glue_plane_b
# 6 = place_position
# 7 = cut_position_a
# 8 = cut_position_b
# 0 = brep
# 1 = centerline
# 2 = cut_plane_a
# 3 = cut_plane_b
# 4 = glue_plane_a
# 5 = glue_plane_b
# 6 = place_position
merge_2 = Merge(Data1=py3.padded, Data2=pln)
Z_4 = UnitZ(Factor=1)

# ---- group: tree
data_2 = Data(merge_2)

data_3 = Data(merge_2)

# ----
# Cut Position A
# o = derived
# x = centerline
# y = derived
# z = z-
panel_3 = Panel("2")
item_3 = ListItem(List=data_2, Index=panel_3, Wrap=True)

# ---- group: cut_plane_a
pln_2 = Plane(item_3)

# ----
orient = Orient(Geometry=data_2, Source=pln_2, Target=pl)  # -> Geometry, Transform
item_4 = ListItem(List=orient.Geometry, Index="6", Wrap=True)

# ---- group: tree
data_4 = Data(orient.Geometry)

# ----
# Cut Position A
number_slider = Slider(500, range=0..3000)
cluster = Cluster_3(tree=data_4, plane=pl_2, eax=number_slider)  # -> brep, target

# ---- group: cut_position_a
pln_3 = Plane(item_4)

# ---- group: cut_brep_a
brep_2 = Brep(cluster.brep)

# ---- group: cut_target_a
T_2 = Target(cluster.target)

# ----
# Cut Position B
# o = derived
# x = centerline
# y = derived
# z = z-
panel_4 = Panel("3")
item_5 = ListItem(List=data_3, Index=panel_4, Wrap=True)

# ---- group: cut_plane_b
pln_4 = Plane(item_5)

# ----
orient_2 = Orient(Geometry=data_3, Source=pln_4, Target=pl)  # -> Geometry, Transform
item_6 = ListItem(List=orient_2.Geometry, Index="6", Wrap=True)

# ---- group: tree
data_5 = Data(orient_2.Geometry)

# ----
# Cut Position B
number_slider_2 = Slider(500, range=0..3000)
cluster_2 = Cluster_3(tree=data_5, plane=pl_2, eax=number_slider_2)  # -> brep, target

# ---- group: cut_position_b
pln_5 = Plane(item_6)

# ---- group: cut_positions
merge_3 = Merge(Data1=pln_3, Data2=pln_5)

# ---- group: cut_brep_b
brep_3 = Brep(cluster_2.brep)

# ---- group: cut_target_b
T_3 = Target(cluster_2.target)

# ----
merge_4 = Merge(Data1=merge_2, Data2=merge_3)

# ---- group: tree
data_6 = Data(merge_4)

data_7 = Data(merge_4)

# ----
merge_5 = Merge(Data1=merge, Data2=brep_2, Data3=T_2, Data4=brep_3, Data5=T_3)

# ----
# Glue Position A
# o = derived
# x = centerline
# y = derived
# z = z-
panel_5 = Panel("4")
item_7 = ListItem(List=data_6, Index=panel_5, Wrap=True)

# ---- group: cut_plane_a
pln_6 = Plane(item_7)

# ----
orient_3 = Orient(Geometry=data_6, Source=pln_6, Target=pl_3)  # -> Geometry, Transform
item_8 = ListItem(List=orient_3.Geometry, Index="6", Wrap=True)

# ---- group: tree
data_8 = Data(orient_3.Geometry)

# ----
# Glue Position A
number_slider_3 = Slider(200, range=0..3000)
cluster_3 = Cluster_3(tree=data_8, plane=pl_4, eax=number_slider_3)  # -> brep, target

# ---- group: glue_position_a
pln_7 = Plane(item_8)

# ---- group: glue_brep_a
brep_4 = Brep(cluster_3.brep)

# ---- group: glue_target_a
T_4 = Target(cluster_3.target)

# ----
# Glue Position B
# o = derived
# x = centerline
# y = derived
# z = z-
panel_6 = Panel("5")
item_9 = ListItem(List=data_7, Index=panel_6, Wrap=True)

# ---- group: cut_plane_b
pln_8 = Plane(item_9)

# ----
orient_4 = Orient(Geometry=data_7, Source=pln_8, Target=pl_3)  # -> Geometry, Transform
item_10 = ListItem(List=orient_4.Geometry, Index="6", Wrap=True)

# ----
# Glue Position B
data_9 = Data(orient_4.Geometry)
cluster_4 = Cluster_3(tree=data_9, plane=pl_4, eax=Slider(200, range=0..3000))  # -> brep, target

# ---- group: glue_position_b
pln_9 = Plane(item_10)

# ---- group: glue_brep_b
brep_5 = Brep(cluster_4.brep)

# ---- group: glue_target_b
T_5 = Target(cluster_4.target)

# ---- group: glue_positions
merge_6 = Merge(Data1=pln_7, Data2=pln_9)

# ----
merge_7 = Merge(Data1=merge_5, Data2=brep_4, Data3=T_4, Data4=brep_5, Data5=T_5)
data_10 = Data(merge_7)

fab_visualize = ClusterOutput(data_10)  # 0 = place_brep 1 = place_target 2 = cut_brep_a 3 = cut_target_a 4 = cut_brep_b 5 = cut_target_b 6 = glue_brep_a 7 = glue_target_a 8 = glue_brep_b 9 = glue_target_b

merge_8 = Merge(Data1=merge_4, Data2=merge_6)

# ---- group: tree
# PICK
data_11 = Data(merge_8)

# ----
# Beam Size
# calculates necessary raw beam size
panel_7 = Panel("0")
item_11 = ListItem(List=data_11, Index=panel_7, Wrap=True)
item_12 = ListItem(List=data_11, Index="1", Wrap=True)
panel_8 = Panel("""small
large
too big?""")

# ---- group: brep
brep_6 = Brep(item_11)

# ---- group: centerline
line_2 = Line(item_12)

# ----
midpt = CurveMiddle(Curve=line_2)
pl_6 = ConstructPlane(Origin=midpt, XAxis=line_2, YAxis=Z_4)

bbox = BoundingBox(Content=brep_6, Plane=pl_6)  # -> simplify(Box), Box_2
ext = ExtendCurve(Curve=line_2, Type=0, Start="1000", End="1000")
blx = BrepLine(Brep=bbox.Box, Line=ext, LimitToFirst=False)  # -> Curves, simplify(Points)
item_13 = ListItem(List=blx.Points, Index=0, Wrap=True)  # -> Item, Item1
ln = Line(StartPoint=item_13.Item, EndPoint=item_13.Item1)
len = Length(Curve=ln)
addition_2 = Addition(A=len, B=Slider(20, range=0..50))
expression = Expression(x=addition_2, Expression="if(x<400, 0, if(x<800, 1, 2))")
item_14 = ListItem(List=panel_8, Index=expression, Wrap=True)

# ---- group: beam_size
data_12 = Data(item_14)

# ----
merge_9 = Merge(Data1=merge_8, Data2=data_12)

fab_data_2 = ClusterOutput(merge_9)  # 0 = brep 1 = centerline 2 = cut_plane_a 3 = cut_plane_b 4 = glue_plane_a 5 = glue_plane_b 6 = place_position 7 = cut_position_a 8 = cut_position_b 9 = glue_position_a 10 = glue_position_b 11 = beam_size

# ==== cluster Cluster_5
layer = ClusterInput()
tree = ClusterInput()
element = ClusterInput()
robot = ClusterInput()
path = ConstructPath(Indices=[layer, element])
branch = TreeBranch(Tree=tree, Path=path, MaintainPaths=True)
dispatch = Dispatch(List=branch, DispatchPattern=[True, False])  # -> ListA, ListB
T = Target(dispatch.ListB)
ik = InverseKinematics(
    Robot=robot,
    Movement=T,
    Closest_Robot_Joint_Position=False,
    Output_Configuration_Data=False,
    Output_Posed_Meshes=True,
    Set_Hide_Mesh=False)  # -> RobotJointPosition, ExternalJointPosition, PosedMeshes
mesh = ClusterOutput(ik.PosedMeshes)
brep = ClusterOutput(dispatch.ListA)

# ==== cluster Cluster_6

# ---- group: Güdel Rail
Y = UnitY(Factor=1)
pt = Point(Point(-663, 466, -2.386439411))
X = UnitX(Factor=1)
neg = Negative(Value=Y)
pl = ConstructPlane(Origin=pt, XAxis=neg, YAxis=X)
X_2 = UnitX(Factor=1)
mesh = Mesh(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)
mesh_2 = Mesh(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)
external_linear_axis = ExternalLinearAxis(
    Name="default_ela",
    AttachmentPlane=pl,
    Axis=X_2,
    AxisLimits="0 To 3000",
    BaseMesh=mesh,
    LinkMesh=mesh_2,
    MovesRobot=Toggle(True),
    Set_Axis_Logic_Number=False,
    Set_Moves_Robot=True)

# ---- group: TODO
pt_2 = Point(Point(0.7976066589, 0.6976066589, -203.5))
xy = XYPlane(Origin=Point(0, 0, 0))
xy_2 = XYPlane(Origin=pt_2)
flip_plane_x = FlipPlaneX(Plane=xy)
flip_plane_x_2 = FlipPlaneX(Plane=xy_2)
mesh_3 = Mesh(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)
robtool = RobotTool(Name="tool1", Mesh=mesh_3, AttachmentPlane=flip_plane_x, ToolPlane=flip_plane_x_2)

# ----
robpres = RobotPreset(PositionPlane=PlaneXY(0, 0, 0), RobotTool=robtool, ExternalAxis=external_linear_axis, Robot_Preset_Number=60)
R = ClusterOutput(robpres)

# ==== cluster Cluster_7
tree = ClusterInput()
robot = ClusterInput()
dispatch = Dispatch(List=tree, DispatchPattern=[True, False])  # -> ListA, ListB
T = Target(dispatch.ListB)
ik = InverseKinematics(
    Robot=robot,
    Movement=T,
    Closest_Robot_Joint_Position=False,
    Output_Configuration_Data=False,
    Output_Posed_Meshes=True,
    Set_Hide_Mesh=False)  # -> RobotJointPosition, ExternalJointPosition, PosedMeshes
mesh = ClusterOutput(ik.PosedMeshes)
brep = ClusterOutput(dispatch.ListA)

# ==== cluster Cluster_13
number_slider = Slider(25, range=0..100)
geo = Geometry([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])
neg = Negative(Value=Slider(600, range=0..1000))
rectangle = Rectangle(Plane=PlaneXY(0, 0, 0), XSize=Slider(2500, range=0..10000), YSize=neg, Radius=0)  # -> Rectangle, Length
division = Division(A=number_slider, B="2")
neg_2 = Negative(Value=division)
boxrec = BoxRectangle(Rectangle=rectangle.Rectangle, Height=Slider(300, range=0..1000))
dom = ConstructDomain(DomainStart=neg_2, DomainEnd=division)
# CHAOS (do not copy)
cluster = Cluster_8(C=geo, A_2=boxrec, A=number_slider)
geo_2 = Geometry([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])
geo_3 = Geometry([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])
geo_4 = Geometry([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])
cluster_2 = Cluster_10(C=geo_2, A_2=boxrec, A=number_slider, C_2=geo_3, C_3=geo_4)
number_slider_2 = Slider(100, range=0..100)
graft = GraftTree(Tree=geo, IncludeEmptyLists=True, IncludeNullItems=True)
ext = ExtendCurve(Curve=geo_2, Type=0, Start=number_slider_2, End=number_slider_2)
crv = Curve(graft)
brep = Brep(cluster)
graft_2 = GraftTree(Tree=ext, IncludeEmptyLists=True, IncludeNullItems=True)
trim = TrimWithBrep(Curve=graft_2, Brep=cluster_2)  # -> Inside, Outside
trim_2 = TrimTree(Tree=trim.Inside, Depth=1)
cluster_3 = Cluster_12(crv=crv, x=division, L=Slider(20, range=0..100))  # -> G, G_2
cluster_4 = Cluster_11(C=crv, B=brep)  # -> T_2, T
brep_2 = Brep(cluster_2)
crv_2 = Curve(trim_2)
cluster_5 = Cluster_12(crv=crv_2, x=division, L=Slider(12, range=0..100))  # -> G, G_2
cluster_6 = Cluster_11(C=crv_2, B=brep_2)  # -> T_2, T
merge = Merge(Data1=brep, Data2=crv, Data3=cluster_4.T_2, Data4=cluster_4.T, Data5=cluster_3.G, Data6=cluster_3.G_2)
merge_2 = Merge(Data1=brep_2, Data2=crv_2, Data3=cluster_6.T_2, Data4=cluster_6.T, Data5=cluster_5.G, Data6=cluster_5.G_2)
path_mapper = PathMapper(merge_2, source="{0;A}", target="{1;A}")
merge_3 = Merge(Data1=merge, Data2=path_mapper)
R = ClusterOutput(merge_3)

# ==== cluster Cluster
crv = ClusterInput()
data = ClusterInput()
crv_2 = Curve(crv)
data_2 = Data(data)
Z = UnitZ(Factor=1)
end = EndPoints(Curve=crv_2)  # -> Start, End
xprod = CrossProduct(VectorA=crv_2, VectorB=Z, Unitize=False)  # -> Vector, Length
Z_2 = UnitZ(Factor=1)
pl = ConstructPlane(Origin=end.Start, XAxis=xprod.Vector, YAxis=Z_2)
rectangle = Rectangle(Plane=pl, XSize=data_2, YSize=data_2, Radius=0)  # -> Rectangle, Length
swp1 = Sweep1(Rail=crv_2, Sections=rectangle.Rectangle, Miter=1)
cap = CapHoles(Brep=swp1)
B = ClusterOutput(cap)

# ==== cluster Cluster_3
tree = ClusterInput()
xy = XYPlane(Origin=Point(0, 0, 0))
plane = ClusterInput()
geo = Geometry(tree)
eax = ClusterInput()
orient = Orient(Geometry=geo, Source=xy, Target=plane)  # -> Geometry, Transform
item = ListItem(List=orient.Geometry, Index="0", Wrap=True)
item_2 = ListItem(List=orient.Geometry, Index="6", Wrap=True)
brep = ClusterOutput(item)
rt = RobotTarget(Plane=item_2, ExternalJointPosition=eax, Set_External_Joint_Position=True, Set_Reference_Plane=False)
target = ClusterOutput(rt)

# ==== cluster Cluster_8
A = ClusterInput()
division = Division(A=A, B="2")
number_slider = Slider(100, range=0..100)
C = ClusterInput()
ext = ExtendCurve(Curve=C, Type=0, Start=number_slider, End=number_slider)
neg = Negative(Value=division)
dom = ConstructDomain(DomainStart=neg, DomainEnd=division)
graft = GraftTree(Tree=ext, IncludeEmptyLists=True, IncludeNullItems=True)
Z = UnitZ(Factor=1)
end = EndPoints(Curve=graft)  # -> Start, End
xprod = CrossProduct(VectorA=graft, VectorB=Z, Unitize=False)  # -> Vector, Length
Z_2 = UnitZ(Factor=1)
pl = ConstructPlane(Origin=end.Start, XAxis=xprod.Vector, YAxis=Z_2)
data = Data(dom)
rectangle = Rectangle(Plane=pl, XSize=data, YSize=data, Radius=0)  # -> Rectangle, Length
swp1 = Sweep1(Rail=graft, Sections=rectangle.Rectangle, Miter=1)
cap = CapHoles(Brep=swp1)
A_2 = ClusterInput()
sint = SolidIntersection(BrepsA=A_2, BrepsB=cap)
trim = TrimTree(Tree=sint, Depth=1)
T = ClusterOutput(trim)

# ==== cluster Cluster_10
A = ClusterInput()
number_slider = Slider(100, range=0..100)
C = ClusterInput()
division = Division(A=A, B="2")
ext = ExtendCurve(Curve=C, Type=0, Start=number_slider, End=number_slider)
neg = Negative(Value=division)
dom = ConstructDomain(DomainStart=neg, DomainEnd=division)
graft = GraftTree(Tree=ext, IncludeEmptyLists=True, IncludeNullItems=True)
Z = UnitZ(Factor=1)
end = EndPoints(Curve=graft)  # -> Start, End
xprod = CrossProduct(VectorA=graft, VectorB=Z, Unitize=False)  # -> Vector, Length
C_2 = ClusterInput()
Z_2 = UnitZ(Factor=1)
C_3 = ClusterInput()
pl = ConstructPlane(Origin=end.Start, XAxis=xprod.Vector, YAxis=Z_2)
cluster = Cluster_9(C=C_2)
data = Data(dom)
cluster_2 = Cluster_9(C=C_3)
rectangle = Rectangle(Plane=pl, XSize=data, YSize=data, Radius=0)  # -> Rectangle, Length
merge = Merge(Data1=cluster, Data2=cluster_2)
swp1 = Sweep1(Rail=graft, Sections=rectangle.Rectangle, Miter=1)
cap = CapHoles(Brep=swp1)
A_2 = ClusterInput()
sint = SolidIntersection(BrepsA=A_2, BrepsB=cap)
sint_2 = SolidIntersection(BrepsA=merge, BrepsB=sint)
trim = TrimTree(Tree=sint_2, Depth=1)
T = ClusterOutput(trim)

# ==== cluster Cluster_11
C = ClusterInput()
B = ClusterInput()
end = EndPoints(Curve=C)  # -> Start, End
debrep = DeconstructBrep(Brep=B)  # -> Faces, Edges, Vertices
area = Area(Geometry=debrep.Faces)  # -> Area, Centroid
cp = ClosestPoint(Point=end.Start, Cloud=area.Centroid)  # -> ClosestPoint, CPIndex, Distance
cp_2 = ClosestPoint(Point=end.End, Cloud=area.Centroid)  # -> ClosestPoint, CPIndex, Distance
item = ListItem(List=debrep.Faces, Index=cp.CPIndex, Wrap=True)
item_2 = ListItem(List=debrep.Faces, Index=cp_2.CPIndex, Wrap=True)
area_2 = Area(Geometry=item)  # -> Area, Centroid
area_3 = Area(Geometry=item_2)  # -> Area, Centroid
brep_cp = BrepClosestPoint(Point=area_2.Centroid, Brep=item)  # -> Point, Normal, Distance
brep_cp_2 = BrepClosestPoint(Point=area_3.Centroid, Brep=item_2)  # -> Point, Normal, Distance
Z = UnitZ(Factor=1)
Z_2 = UnitZ(Factor=1)
xprod = CrossProduct(VectorA=Z, VectorB=brep_cp.Normal, Unitize=False)  # -> Vector, Length
xprod_2 = CrossProduct(VectorA=Z_2, VectorB=brep_cp_2.Normal, Unitize=False)  # -> Vector, Length
pl = ConstructPlane(Origin=brep_cp.Point, XAxis=xprod.Vector, YAxis=Z)
pl_2 = ConstructPlane(Origin=brep_cp_2.Point, XAxis=xprod_2.Vector, YAxis=Z_2)
pv = PlaneVisualizer(Plane=pl_2)
trim = TrimTree(Tree=pl, Depth=1)
pv_2 = PlaneVisualizer(Plane=pl)
trim_2 = TrimTree(Tree=pl_2, Depth=1)
T = ClusterOutput(trim_2)
T_2 = ClusterOutput(trim)

# ==== cluster Cluster_12
crv = ClusterInput()
crv_2 = Curve(crv)
L = ClusterInput()
len = Length(Curve=crv_2)
toggle = BooleanToggle(False)
subtraction = Subtraction(A=len, B=L)
eval = EvaluateLength(Curve=crv_2, Length=L, Normalized=toggle)  # -> Point, Tangent, Parameter
eval_2 = EvaluateLength(Curve=crv_2, Length=subtraction, Normalized=toggle)  # -> Point, Tangent, Parameter
midpt = CurveMiddle(Curve=crv_2)
vec2pt = Vector2Pt(PointA=eval.Point, PointB=midpt, Unitize=False)  # -> Vector, Length
vec2pt_2 = Vector2Pt(PointA=eval_2.Point, PointB=midpt, Unitize=False)  # -> Vector, Length
Z = UnitZ(Factor=1)
Z_2 = UnitZ(Factor=1)
xprod = CrossProduct(VectorA=vec2pt_2.Vector, VectorB=Z, Unitize=False)  # -> Vector, Length
xprod_2 = CrossProduct(VectorA=vec2pt.Vector, VectorB=Z_2, Unitize=False)  # -> Vector, Length
x = ClusterInput()
pl = ConstructPlane(Origin=eval_2.Point, XAxis=vec2pt_2.Vector, YAxis=xprod.Vector)
pl_2 = ConstructPlane(Origin=eval.Point, XAxis=vec2pt.Vector, YAxis=xprod_2.Vector)
neg = Negative(Value=x)
Z_3 = UnitZ(Factor=neg)
move = Move(Geometry=pl_2, Motion=Z_3)  # -> Geometry, Transform
move_2 = Move(Geometry=pl, Motion=Z_3)  # -> Geometry, Transform
G = ClusterOutput(move.Geometry)
G_2 = ClusterOutput(move_2.Geometry)

# ==== cluster Cluster_9
number_slider = Slider(100, range=0..100)
C = ClusterInput()
ext = ExtendCurve(Curve=C, Type=0, Start=number_slider, End=number_slider)
loft = Loft(Curves=ext, Options={Adjust=False, Closed=False, LoftEnds=0, LoftSimp=0, LoftType=0, Rebuild=10, Refit=0.01})
boxrec = BoxRectangle(Rectangle=loft, Height=Slider(300, range=0..1000))
B = ClusterOutput(boxrec)
